# Grasshopper definition gh-test.gh (Grasshopper 1.0.7)
# plug-ins: Tracker

natnet_listener = SimpleNatNetListener(Activate=Toggle(True), LocalIP="127.0.0.1", ServerIP="127.0.0.1", SampleRate=Slider(5, range=1..5))  # -> Status, Data
split = TextSplit(Text=natnet_listener.Data, Separators="=(),")
panel = Panel(split)
item = ListItem(List=split, Index=0, Wrap=True)  # -> Item, Item1, Item2, Item3, Item4
pt = ConstructPoint(XCoordinate=item.Item2, YCoordinate=item.Item4, ZCoordinate=item.Item3)
rec = DataRecorder(pt, DataLimit=-10, RecordData=True)
pline = PolyLine(Vertices=rec, Closed=False)
